# Grasshopper definition KangSolver Equalize Lenght.gh (Grasshopper 1.0.7)
# plug-ins: Kangaroo2 Components, karambaGH

# ---- group: Eval Mesh Topology
mesh = Relay()
connectivity = Relay()
vert = Relay()

# ----
number_slider = Slider(10000, range=0..10000)

# ---- group: Imposed Member Lenght
number_slider_2 = Slider(0.7, range=0.5..10)

# ----
show = Show(G=connectivity)

# ---- group: Select Anchor Points
anchor = Anchor(Strength=10000)

# ----
onmesh = OnMesh(Points=vert, Mesh=mesh, Strength=Slider(1000, range=0..1000))
length_line = LengthLine(Line=connectivity, Length=number_slider_2, Strength=number_slider)
equallength = EqualLength(Line=connectivity, Strength=number_slider)

# ---- group: START SOLVER
restart = BooleanToggle(True)
reset = Button()

# ----
entwine = Entwine(Branch00=[length_line, equallength, onmesh, anchor], Branch01=show, FlattenInputs=True)
solver = Solver(GoalObjects=entwine, Reset=reset, Threshold=1e-15, Tolerance=0.01, On=restart)  # -> I, V, O

# ---- group: MEMBER's Lenght Evaluation
bang = ExplodeTree(Data=solver.O)  # -> Branch0, Branch1
rdlines = RemoveDuplicateLinesKaramba3D(Line=bang.Branch1, LimitDistance=0.005)  # -> OutLine, Info, Indexes
len = Length(Curve=rdlines.OutLine)
sort = SortList(Keys=len)  # -> Keys, ValuesA
lenght_eval = Panel(sort.Keys)
